# Grasshopper definition basic_sub_class_test.gh (Grasshopper 1.0.7)

# ----
# Base HB Aperture
panel = Panel("0,9,1")
Z = UnitZ(Factor="8")
ln = Line(StartPoint="0,1,1", EndPoint=panel)
extr = Extrude(Base=ln, Direction=Z)
aperture = HBAperture(geo=extr)  # -> report, apertures; plug-in component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

# ----
# Base HB Room
panel_2 = Panel("0,0,0")
box = Box2Pt(PointA=panel_2, PointB="10,10,10", Plane=PlaneXY(0, 0, 0))
roomsolid = HBRoomFromSolid(geo=flatten(box), conditioned=True)  # -> report, rooms; plug-in component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

# ---- group: Sublcass Aperture, Add new Attr
phx_aperture = GhPythonScript(aperture=aperture.apertures, test_attr="This Is A Test Value")  # -> out, aperture
# ---------- phx_aperture: Python ----------
from honeybee.aperture import Aperture
from honeybee.typing import clean_and_id_string

class PHX_Aperture(Aperture):
    """Test class to explore Subclassing potential"""
    
    def __init__(self, _name, geometry, test_attr):
        super(PHX_Aperture, self).__init__(_name, geometry)
        super(PHX_Aperture, self).add_prefix('PHX')
        # -- Try and add a new attribute to the object
        self.test_attr = test_attr # <-----
        
    def to_dict(self, abridged=False, included_prop=None, include_plane=True):
        base = super(PHX_Aperture, self).to_dict(abridged,included_prop,include_plane)
        
        # -- Have to update the dict with the new attributes
        base.update({'test_attr':self.test_attr})
        
        return base
     
    def from_dict(self, data):
        base = super(PHX_Aperture, self).from_dict(data)
        
        # -- Have to call the new obj constructure
        # -- This won't work with the native HB 'StrToObj' though, since it 
        # -- won't know about any of this part....
        phx = PHX_Aperture(base.identifier, base.geometry, self.test_attr)
        phx.test_attr = data['test_attr']
        
        return phx
    
    def __setattr__(self, attr_name, value):
        """Intercept any attribute setting done during instantiation or later on"""
        
        if attr_name == 'is_operable':
            print 'I saw that! You set "{}" to: "{}"'.format(attr_name, value)
            print 'I might set some stuff on the PHX model based on that...'
        
        return super(PHX_Aperture, self).__setattr__(attr_name, value)
    
    def duplicate(self):
        return self.__copy__()
    
    def __copy__(self):
        base = super(PHX_Aperture, self).__copy__()
        
        # -- Create a new PHX Object based on the original
        phx = PHX_Aperture(base.identifier, base.geometry, self.test_attr)
        
        return phx

# -- 
name = clean_and_id_string('Aperture')
aperture_ = PHX_Aperture(name, _aperture.geometry, _test_attr)
# ---------- end phx_aperture ----------

# ----
# New Attribute / Value comes through into
# the JSON ok.
objtostr = HBObjectToString(hb_obj=phx_aperture.aperture)  # -> hb_str; plug-in component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

# ----
# But this won't work since the HB Object
# constructor doesn't know about the 'new'
# Attrs on the PHX Aperture type...
strtoobj = HBStringToObject(hb_str=objtostr)  # -> hb_obj; plug-in component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
objtostr_2 = HBObjectToString(hb_obj=strtoobj)  # -> hb_str; plug-in component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
panel_3 = Panel(strtoobj)

tmatch = MatchText(Text=objtostr, RegEx="This Is A Test Value", Case=True)
new_attr_in_the_json = Panel(tmatch)

tmatch_2 = MatchText(Text=objtostr_2, RegEx="This Is A Test Value", Case=True)
new_attr_in_the_json_2 = Panel(tmatch_2)

# ---- group: Try setting an LBT Obj. attribute
python = GhPythonScript(aperture=phx_aperture.aperture, set_operable=Toggle(True))  # -> out, aperture; inputs set_operable: Boolean
# ---------- python: Python ----------
aperture_ = _aperture.duplicate()
aperture_.is_operable = _set_operable
# ---------- end python ----------

# ----
panel_4 = Panel(python.out)
addsubface = HBAddSubface(hb_obj=flatten(roomsolid.rooms), sub_faces=flatten(python.aperture))  # -> hb_obj; plug-in component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
model = HBModel(rooms=flatten(addsubface))  # -> report, model; plug-in component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

objtostr_3 = HBObjectToString(hb_obj=model.model)  # -> hb_str; plug-in component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

tmatch_3 = MatchText(Text=objtostr_3, RegEx="This Is A Test Value", Case=True)
new_attr_in_the_json_3 = Panel(tmatch_3)

dumpobjects = HBDumpObjects(hb_objs=flatten(model.model), folder="\\Mac\Home\Desktop\", indent="2", dump=Toggle(False))  # -> report, hb_file; plug-in component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
