# Grasshopper definition manual-test.ghx (Grasshopper 1.0.8)

point = Point("0,0,0")
point_2 = Point("16.4042, 13.1234, 9.8425")
box_2pt = Box2Pt(PointA=point, PointB=point_2, Plane=PlaneXY(0, 0, 0))
roomsolid = HBRoomFromSolid(geo=flatten(box_2pt), conditioned=True)  # -> out, rooms; plug-in component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
panel = Panel(box_2pt)

# ---- group: Multi-floor contract check
ghpython_script = GhPythonScript()  # -> out, a
# ---------- ghpython_script: Python ----------
from honeybee.face import Face
from honeybee.facetype import Floor
from honeybee.room import Room
from ladybug_geometry.geometry3d import Face3D, Point3D


def floor_face(identifier, x_offset=0.0, reverse=False):
    points = [
        Point3D(x_offset, 0, 0),
        Point3D(x_offset + 2, 0, 0),
        Point3D(x_offset + 2, 3, 0),
        Point3D(x_offset, 3, 0),
    ]

    if reverse:
        points.reverse()

    return Face(identifier, Face3D(points), Floor())


first = floor_face("SplitRoom_Floor_1", reverse=True)
second = floor_face("SplitRoom_Floor_2", x_offset=3)

a = [Room("SplitRoom", [first, second])]
# ---------- end ghpython_script ----------

# ----
panel_2 = Panel(roomsolid.rooms)
create_spaces_from_rooms = HBPHCreateSpacesFromHBRooms(hb_rooms=ghpython_script.a)  # -> out, hb_rooms; inputs hb_rooms: list
# ---------- create_spaces_from_rooms: Python ----------
#
# Honeybee-PH: A Plugin for adding Passive-House data to LadybugTools Honeybee-Energy Models
# 
# This component is part of the PH-Tools toolkit <https://github.com/PH-Tools>.
# 
# Copyright (c) 2022, PH-Tools and bldgtyp, llc <phtools@bldgtyp.com> 
# Honeybee-PH is free software; you can redistribute it and/or modify 
# it under the terms of the GNU General Public License as published 
# by the Free Software Foundation; either version 3 of the License, 
# or (at your option) any later version. 
# 
# Honeybee-PH is distributed in the hope that it will be useful,
# but WITHOUT ANY WARRANTY; without even the implied warranty of 
# MERCHANTABILITY or FITNESS FOR A PARTICULAR PURPOSE. See the 
# GNU General Public License for more details.
# 
# For a copy of the GNU General Public License
# see <https://github.com/PH-Tools/honeybee_ph/blob/main/LICENSE>.
# 
# @license GPL-3.0+ <http://spdx.org/licenses/GPL-3.0+>
#
"""
Create default PH-Spaces based on the Honeybee-Room geometry. Note that you 
may run into errors with complex Room shapes. This component is designed for 
simple rooms only. For complex rooms, build detailed Spaces with the "HBPH - Create Spaces" component.
-
EM March 19, 2022
    Args:
        _hb_rooms: (list[Room]) The list of honeybee-Rooms to add to the spaces to.
            
    Returns:
        hb_rooms_: The honeyee-Rooms with the PH Spaces added to them.
"""

import scriptcontext as sc
import Rhino as rh
import rhinoscriptsyntax as rs
import ghpythonlib.components as ghc
import Grasshopper as gh

from honeybee_ph_rhino import gh_compo_io, gh_io

# ------------------------------------------------------------------------------
import honeybee_ph_rhino._component_info_
reload(honeybee_ph_rhino._component_info_)
ghenv.Component.Name = "HBPH - Create Spaces from HB-Rooms"
DEV = honeybee_ph_rhino._component_info_.set_component_params(ghenv, dev=False)
if DEV:
    from honeybee_ph_rhino.gh_compo_io import space_create_from_hb_rooms as gh_compo_io
    reload(gh_compo_io)
    reload(gh_io)

# ------------------------------------------------------------------------------
# -- GH Interface
IGH = gh_io.IGH( ghdoc, ghenv, sc, rh, rs, ghc, gh )

# ------------------------------------------------------------------------------
gh_compo_interface = gh_compo_io.GHCompo_CreatePHSpacesFromHBRooms(
    IGH,
    _hb_rooms,
    )
hb_rooms_ = gh_compo_interface.run()
# ---------- end create_spaces_from_rooms ----------
create_spaces_from_rooms_2 = HBPHCreateSpacesFromHBRooms(hb_rooms=roomsolid.rooms)  # -> out, hb_rooms; inputs hb_rooms: list; same code as create_spaces_from_rooms
ghpython_script_2 = GhPythonScript(rooms=create_spaces_from_rooms.hb_rooms)  # -> out, a; inputs rooms: list
# ---------- ghpython_script_2: Python ----------
from honeybee.room import Room

rows = []

for hb_room in rooms or []:
    spaces = hb_room.properties.ph.spaces
    restored_room = Room.from_dict(hb_room.to_dict())
    restored_spaces = restored_room.properties.ph.spaces

    rows.append("ROOM: {}".format(hb_room.display_name))
    rows.append("space_count: {}".format(len(spaces)))
    rows.append(
        "roundtrip_space_count: {}".format(len(restored_spaces))
    )

    for ph_space in spaces:
        rows.append("space_name: {}".format(ph_space.name))
        rows.append("host_is_output_room: {}".format(
            ph_space.host is hb_room
        ))
        rows.append("volume_count: {}".format(
            len(ph_space.volumes)
        ))
        rows.append("floor_segment_count: {}".format(
            len(ph_space.floor_segments)
        ))
        rows.append("floor_area: {}".format(
            ph_space.floor_area
        ))
        rows.append("weighted_floor_area: {}".format(
            ph_space.weighted_floor_area
        ))
        rows.append("net_volume: {}".format(
            ph_space.net_volume
        ))
        rows.append("volume_heights: {}".format(
            [v.avg_ceiling_height for v in ph_space.volumes]
        ))

    for restored_space in restored_spaces:
        rows.append("roundtrip_host_ok: {}".format(
            restored_space.host is restored_room
        ))

a = "\n".join(rows)
# ---------- end ghpython_script_2 ----------
ghpython_script_3 = GhPythonScript(rooms=create_spaces_from_rooms_2.hb_rooms)  # -> out, a; inputs rooms: list; same code as ghpython_script_2
panel_3 = Panel(ghpython_script_2.a)
panel_4 = Panel(ghpython_script_3.a)
