# Grasshopper definition 211205.gh (Grasshopper 1.0.7)

box = Box2Pt(PointA="10,0,0", PointB="20,10,3", Plane=PlaneXY(0, 0, 0))
box_2 = Box2Pt(PointA="0,0,0", PointB="10,10,6", Plane=PlaneXY(0, 0, 0))
roomsolid = HBRoomFromSolid(geo=flatten(box_2), name="First Room", conditioned=True)  # -> report, rooms; plug-in component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
roomsolid_2 = HBRoomFromSolid(geo=flatten(box), name="Room 2", conditioned=True)  # -> report, rooms; plug-in component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
merge = Merge(Data1=roomsolid.rooms, Data2=roomsolid_2.rooms)  # -> flatten(Result)
python = GhPythonScript(HB_rooms=roomsolid.rooms)  # -> out, space_breps, HB_rooms; inputs HB_rooms: list
# ---------- python: Python ----------
HB_rooms_ = []
for _room in _HB_rooms:
    new_room = _room.duplicate()
    print new_room.properties.ph
    
    for face in new_room.faces:
        print face.properties.ph
# ---------- end python ----------
pyph_mac_pc = __PyPH__Util_Update_Scripts(update_HP_PH=Button())  # -> out; inputs update_PyPH: Boolean, update_HP_PH: Boolean
# ---------- pyph_mac_pc: Python ----------
"""
Updates the PC-side python files for the PyPH_Rhino scripts folders.
---
Source: \\Mac\Home\Dropbox\bldgtyp-00\00_PH_Tools\PyPH\...
Target: C:\Users\edpma\AppData\Roaming\McNeel\Rhinoceros\7.0\scripts\...

"""

import os
import shutil
import scriptcontext as sc
import time
import subprocess

ghenv.Component.Name = "__PyPH__Util_Update_Scripts"
ghenv.Component.NickName = "PyPH Mac->PC"
ghenv.Component.Message = 'NOV_12_2021'
ghenv.Component.IconDisplayMode = ghenv.Component.IconDisplayMode.application
ghenv.Component.Category = "PH-Tools"
ghenv.Component.SubCategory = "00 | Utils"

#--- Set up the path variables
#--- PYPH ---
SRC_DEV_FOLDER_PATH = r"\\Mac\Home\Dropbox\bldgtyp-00\00_PH_Tools\PyPH"
SRC_PHX_PATH = SRC_DEV_FOLDER_PATH + r"\PHX"
SRC_PYPH_RHINO_PATH = SRC_DEV_FOLDER_PATH + r"\PyPH_Rhino"
SRC_LBT_UTILS_PATH = SRC_DEV_FOLDER_PATH + r"\LBT_Utils"
SRC_PYPH_GH_PATH = SRC_DEV_FOLDER_PATH + r"\PyPH_GH"

TRGT_SCRIPTS_PATH = r"C:\Users\edpma\AppData\Roaming\McNeel\Rhinoceros\7.0\scripts"
TRGT_PHX_PATH = TRGT_SCRIPTS_PATH + r"\PHX"
TRGT_PYPH_RHINO_PATH = TRGT_SCRIPTS_PATH + r"\PyPH_Rhino"
TRGT_LBT_UTILS_PATH = TRGT_SCRIPTS_PATH + r"\LBT_Utils"
TRGT_PYPH_GH_PATH = TRGT_SCRIPTS_PATH + r"\PyPH_GH"

#--- Honeybee-PH ----
SRC_HBPH = r"\\Mac\Home\Dropbox\bldgtyp-00\00_PH_Tools\honeybee_ph"
SRC_HBPH_CORE = SRC_HBPH + r"\honeybee_ph"
SRC_HBPH_ENERGY = SRC_HBPH + r"\honeybee_energy_ph"
SRC_HBPH_LBT_GEOM = SRC_HBPH + r"\ladybug_geometry_ph"

TGT_HBPH = r"C:\Users\edpma\ladybug_tools\python\Lib\site-packages\honeybee_ph"
TGT_HBPH_CORE = TGT_HBPH + r"\honeybee_ph"
TGT_HBPH_ENERGY = TGT_HBPH + r"\honeybee_energy_phh="
TGT_HBPH_LBT_GEOM = TGT_HBPH + r"\ladybug_geometry_ph"


#--- Check
#assert os.path.exists(SRC_DEV_FOLDER_PATH), 'MISSING: {}'.format(SRC_DEV_FOLDER_PATH)
#assert os.path.exists(SRC_PHX_PATH), 'MISSING: {}'.format(SRC_PHX_PATH)
#assert os.path.exists(SRC_PYPH_RHINO_PATH), 'MISSING: {}'.format(SRC_PYPH_RHINO_PATH)
#assert os.path.exists(TRGT_SCRIPTS_PATH), 'MISSING: {}'.format(TRGT_SCRIPTS_PATH)
#assert os.path.exists(TRGT_PHX_PATH), 'MISSING: {}'.format(TRGT_PHX_PATH)
#assert os.path.exists(TRGT_PYPH_RHINO_PATH), 'MISSING: {}'.format(TRGT_PYPH_RHINO_PATH)

def copy_all_files_in_folder(src_dir, target_dir, _subfolders=True):
    
    if not os.path.exists(target_dir):
        os.mkdir(target_dir)
    
    src_files = {k:os.path.join( src_dir, k ) for k in os.listdir(src_dir)}
    trgt_files = {k:os.path.join( target_dir, k ) for k in os.listdir(target_dir)}
    any_work_done = False
    
    #-- Files
    for file_name, file_path in src_files.items():
        #--- Filter out:
        if file_name[0] == '.': continue
        if file_name == '__pycache__': continue
        if not os.path.isfile(file_path): continue
        
        #--- If it doesn't exist, just copy it over
        if file_name not in trgt_files:
            trgt_file_path = os.path.join( target_dir, file_name )
            print 'Copying: {} to {}'.format(file_path, trgt_file_path)
            shutil.copyfile(file_path, trgt_file_path)
            any_work_done = True
        else:
            trgt_file_path = trgt_files[file_name]
        
        #--- if the source is newer, copy over
        if os.path.getmtime(file_path) > os.path.getmtime(trgt_file_path):
            print 'Copying: {} to {}'.format(file_path, trgt_file_path)
            shutil.copyfile(file_path, trgt_file_path)
            any_work_done = True
    
    #-- Subfolders
    if _subfolders:
        for file_name, file_path in src_files.items():
            print "file_name:", file_name
            print "file_path:", file_path
            
            #--- Filter out:
            if file_name[0] == '.': continue
            if file_name == '__pycache__': continue
            if not os.path.isdir(file_path): continue
            
            #--- Walk through the Folder tree
            new_target_dir = os.path.join(target_dir, file_name)
            copy_all_files_in_folder(file_path, new_target_dir)


def update(_src, _target, _subfolders=True, _sleep_time=0):
    #Closure
    src_dir = _src
    target_dir = _target
    
    def closure():
        #--- Copy Over
        copy_all_files_in_folder(src_dir, target_dir, _subfolders)
    
    return closure

# Add the update funcs to the sticky dict so the components can use them
#if _add_to_sticky:
#    sc.sticky['PyPH_Update_PHX'] = update(SRC_PHX_PATH, TRGT_PHX_PATH, 1)
#    sc.sticky['PyPH_Update_PyPH'] = update(SRC_PYPH_RHINO_PATH, TRGT_PYPH_RHINO_PATH, 1)
#    sc.sticky['PyPH_Update_LBT_Utils'] = update(SRC_LBT_UTILS_PATH, TRGT_LBT_UTILS_PATH, 1)
#    sc.sticky['PyPH_Update_LBT_Utils'] = update(SRC_PYPH_GH_PATH, TRGT_PYPH_GH_PATH, 1)


if _open_RH_scripts_folder:
    subprocess.Popen('explorer "{}"'.format(TRGT_SCRIPTS_PATH))

if _update_PyPH:
    update(SRC_PHX_PATH, TRGT_PHX_PATH)()
    update(SRC_PYPH_RHINO_PATH, TRGT_PYPH_RHINO_PATH)()
    update(SRC_LBT_UTILS_PATH, TRGT_LBT_UTILS_PATH)()
    update(SRC_PYPH_GH_PATH, TRGT_PYPH_GH_PATH, _subfolders=False)()

if _update_HP_PH:
    update(SRC_HBPH, TGT_HBPH, _subfolders=False)()
    update(SRC_HBPH_CORE, TGT_HBPH_CORE)()
    update(SRC_HBPH_ENERGY, TGT_HBPH_ENERGY)()
    update(SRC_HBPH_LBT_GEOM, TGT_HBPH_LBT_GEOM)()
# ---------- end pyph_mac_pc ----------
solveadj = HBSolveAdjacency(rooms=flatten(merge), run=Toggle(True))  # -> report, adj_rooms; plug-in component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
aperturesbyratio = HBAperturesByRatio(hb_objs=flatten(solveadj.adj_rooms), ratio=".2")  # -> report, hb_objs; plug-in component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
objtostr = HBObjectToString(hb_obj=roomsolid.rooms)  # -> hb_str; plug-in component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
model = HBModel(rooms=flatten(aperturesbyratio.hb_objs))  # -> report, model; plug-in component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
panel = Panel(model.model)
python_2 = GhPythonScript(x=objtostr)  # -> out, a
# ---------- python_2: Python ----------
import json

d = json.loads(x)

print d['properties'].keys()
print d['properties']['ph'].keys()
# ---------- end python_2 ----------
panel_2 = Panel("\\Mac\Dropbox\bldgtyp-00\00_PH_Tools\honeybee_PH\sample\hbjson\")
vizbytype = HBVisualizeByType()  # -> walls, interior_walls, roofs, ceilings, exterior_floors, interior_floors, air_walls, apertures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; plug-in component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
dumpobjects = HBDumpObjects(name="sample_input", folder=panel_2, indent="2", dump=Toggle(False))  # -> report, hb_file; plug-in component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
vizbybc = HBVizualizeByBC()  # -> outdoors, surface, ground, adiabatic, other, wire_frame; plug-in component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
