# Grasshopper definition 211206.gh (Grasshopper 1.0.7)

# ----
# Create PH_Lighting
# (Subclass HBE Lighting)
panel = Panel("1")
constantschedule = HBConstantSchedule(values=panel)  # -> report, schedule, idf_text; plug-in component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
ph_lighting = GhPythonScript(name="MyTest", watts_per_area="12", schedule=constantschedule.schedule)  # -> out, ph_lighting, dup_ph_lighting
# ---------- ph_lighting: Python ----------
import honeybee_energy.load.lighting
reload(honeybee_energy.load.lighting)

try:  # import the core honeybee dependencies
    from honeybee.typing import clean_and_id_ep_string, clean_ep_string
except ImportError as e:
    raise ImportError('\nFailed to import honeybee:\n\t{}'.format(e))
    
# Subclass HB Energy Lighting
class PH_Lighting(honeybee_energy.load.lighting.Lighting):
    __slots__ = ('_test_attr')
    
    def __init__(self, *args, **kwargs):
        super(PH_Lighting, self).__init__(*args, **kwargs)
        self._test_attr = 'this is a test'
    
    @classmethod
    def from_hb_lighting(cls, _hb_lighting):
        new_ph_obj = cls(
            identifier=_hb_lighting.identifier,
            watts_per_area=_hb_lighting.watts_per_area,
            schedule=_hb_lighting.schedule,
            return_air_fraction=_hb_lighting.return_air_fraction,
            radiant_fraction=_hb_lighting.radiant_fraction,
            visible_fraction=_hb_lighting.visible_fraction,)
        
        return new_ph_obj
    
    def ToString(self):
        return 'My New PH_Lighting Object'
    
    def __copy__(self):
        new_hb_obj = super(PH_Lighting, self).__copy__()
        new_ph_obj = PH_Lighting.from_hb_lighting(new_hb_obj)
        new_ph_obj._test_attr = self._test_attr
        return new_ph_obj
        
# Create a new PH Lighting Obj
name = clean_ep_string(_name)
ph_lighting_ = PH_Lighting(name, _watts_per_area, _schedule)
print ph_lighting_._test_attr

dup_ph_lighting_ = ph_lighting_.duplicate()
print dup_ph_lighting_
print dup_ph_lighting_._test_attr #- Works
# ---------- end ph_lighting ----------

searchprog = HBSearchPrograms()  # -> room_prog; plug-in component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
box = CenterBox(Base=PlaneXY(0, 0, 0), X=1, Y=1, Z=1)
roomsolid = HBRoomFromSolid(geo=flatten(box), conditioned=True)  # -> report, rooms; plug-in component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
item = ListItem(List=searchprog, Index="0", Wrap=True)
programtype = HBProgramType(name="Test_Program", base_program=item, lighting=ph_lighting.dup_ph_lighting)  # -> program; plug-in component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
panel_2 = Panel(ph_lighting.dup_ph_lighting)
python = GhPythonScript(x=ph_lighting.dup_ph_lighting)  # -> out, a
# ---------- python: Python ----------
import honeybee_energy.load.lighting

print 'type:', type(x)
print 'isinstance:', isinstance(x, honeybee_energy.load.lighting.Lighting)
# ---------- end python ----------
panel_3 = Panel(programtype)
applyprogram = HBApplyProgramType(rooms=flatten(roomsolid.rooms), program=programtype)  # -> report, rooms; plug-in component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
