# Grasshopper definition 211207.gh (Grasshopper 1.0.7)

# ----
# Create PH_Lighting
# (Subclass HBE Lighting)
panel = Panel("12")
constantschedule = HBConstantSchedule(values="1")  # -> report, schedule, idf_text; plug-in component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
ph_lighting = GhPythonScript(name="MyTest", watts_per_area=panel, schedule=constantschedule.schedule)  # -> out, ph_lighting, dup_ph_lighting
# ---------- ph_lighting: Python ----------
try:  # import the core honeybee dependencies
    from honeybee.typing import clean_and_id_ep_string, clean_ep_string
except ImportError as e:
    raise ImportError('\nFailed to import honeybee:\n\t{}'.format(e))

import honeybee_energy_ph.load.lighting
reload(honeybee_energy_ph.load.lighting)
from honeybee_energy_ph.load.lighting import PH_Lighting

# Create a new PH Lighting Obj
name = clean_ep_string(_name)
ph_lighting_ = PH_Lighting(name, _watts_per_area, _schedule)
print ph_lighting_._test_attr

dup_ph_lighting_ = ph_lighting_.duplicate()
print dup_ph_lighting_
print dup_ph_lighting_._test_attr #- Works
# ---------- end ph_lighting ----------

box = CenterBox(Base=PlaneXY(0, 0, 0), X=1, Y=1, Z=1)
searchprog = HBSearchPrograms()  # -> room_prog; plug-in component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
roomsolid = HBRoomFromSolid(geo=flatten(box), conditioned=True)  # -> report, rooms; plug-in component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
item = ListItem(List=searchprog, Index="0", Wrap=True)
panel_2 = Panel("Test_Program")
panel_3 = Panel(ph_lighting.dup_ph_lighting)
programtype = HBProgramType(base_program=item, lighting=ph_lighting.dup_ph_lighting)  # -> program; plug-in component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

# ----
# Try and Modify the Object’s Attributes
panel_4 = Panel("14")
applyloadvals = HBApplyLoadValues(room_or_program=flatten(programtype), lighting_per_floor=panel_4)  # -> report, mod_obj; plug-in component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
deconstrprogram = HBDeconstructProgramType(program=applyloadvals.mod_obj)  # -> people, lighting, electric_equip, gas_equip, hot_water, infiltration, ventilation, setpoint; plug-in component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

applyprogram = HBApplyProgramType(rooms=flatten(roomsolid.rooms), program=applyloadvals.mod_obj)  # -> report, rooms; plug-in component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
panel_5 = Panel(applyprogram.rooms)
model = HBModel(rooms=flatten(applyprogram.rooms))  # -> report, model; plug-in component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
panel_6 = Panel(model.model)
objtostr = HBObjectToString(hb_obj=deconstrprogram.lighting)  # -> hb_str; plug-in component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
panel_7 = Panel(deconstrprogram.lighting)
panel_8 = Panel(objtostr)
